# Grasshopper definition 01_Opuntia_Basic_Cablenet.gh (Grasshopper 1.0.8)
# plug-ins: Opuntia

# To work with the FDM, the input lines must first be converted into a graph using the LGraph component. It merges vertices, removes duplicate edges and outputs the adjacency trees (PP,PL,LP) required by the solver.
cables = Line([Line((-5, -5, 0), (-2.5, -5, 0)), Line((0, -5, 0), (2.5, -5, 0)), Line((-5, 0, 0), (-2.5, 0, 0)), Line((0, 0, 0), (2.5, 0, 0)), Line((-5, 5, 4), (-2.5, 5, 0)), Line((-5, -5, 0), (-5, -2.5, 0))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])
# This example shows the form-finding of a classic four-point cable net:
# two anchor points are raised and two are lowered, resulting in an anticlastic, saddle-shaped surface.
# The coordinates, force densities and load vectors are taken from the STIFF example dataset of TU Munich:
# https://www.cee.ed.tum.de/fileadmin/w00cbe/st/Software/Education/Stiff/Beispiele/Kraftdichte_4P-Zelt_1_3D.xlsx
anchorpts = Point([Point(-5, 5, 4), Point(5, -5, 4), Point(5, 5, 0), Point(-5, -5, 0)])
lgraph = LineGraph(Lines=cables, Tolerance=0.001)  # -> Vertices, Edges, PP, PL, LP
cp = ClosestPoint(Point=anchorpts, Cloud=lgraph.Vertices)  # -> ClosestPoint, CPIndex, Distance
# (1)
lng = ListLength(List=lgraph.Edges)
q = Panel("1")
# 1) Force densities are assigned per edge. First, all edges are given a value of 1; the edge-cables are then overwritten with a value of 5.
# Note: The indices in "Indices_Edge_Cables" refer to the edge order of LGraph. If the input geometry is changed, they must be updated accordingly.
# 
# 2) For the form-finding of prestressed tension structures, the load vector is {0,0,0}. As this is the default, the "P" input can be left empty.
indices_edge_cables = Panel("""0
11
1
14
9
21
10
22
16
35
13
4
18
6
17
5""")
repeat = RepeatData(Data=q, Length=lng)
q_2 = Panel("5")
replace = ReplaceItems(List=repeat, Item=q_2, Indices=indices_edge_cables, Wrap=False)
# (2)
fdsolver = ForceDensitySolver(
    AnchorIndices=cp.CPIndex,
    Vertices=lgraph.Vertices,
    PP=lgraph.PP,
    PL=lgraph.PL,
    LP=lgraph.LP,
    ForceDensity=replace,
    MaxIterations=1000,
    Tolerance=0.001)  # -> Vertices, Forces, Lengths, Lines, Residuals, NodeDelta
axial_forces_n_0_tension_n_0_compression = Panel(fdsolver.Forces)
# The solver returns the equilibrium node positions (V), the axial force (N = q · L) and length (L) of each edge, the resulting edge geometry (E), as well as the residual force (Res) and the final displacement (dV) of each node for checking convergence.
formfound_cables = Line(fdsolver.Lines)

# ---- group: Visualisation
preview = CustomPreview(
    Geometry=formfound_cables,
    Material={diffuse=RGB(255, 0, 255), emission=RGB(76, 0, 76), shine=0.5, specular=RGB(255, 255, 255), transparency=0})
