# Grasshopper definition 01_Opuntia_Cablenet.gh (Grasshopper 1.0.8)
# plug-ins: Opuntia

# This example shows the form-finding of a classic four-point cable net:
# two anchor points are raised and two are lowered, resulting in an anticlastic, saddle-shaped surface.
# The coordinates, force densities and load vectors are taken from the STIFF example dataset of TU Munich:
# https://www.cee.ed.tum.de/fileadmin/w00cbe/st/Software/Education/Stiff/Beispiele/Kraftdichte_4P-Zelt_1_3D.xlsx
anchorpts = Point([Point(-5, 5, 4), Point(5, -5, 4), Point(5, 5, 0), Point(-5, -5, 0)])
# Zoom here to get the outputs for the adjacency trees.
# To work with the FDM, the input lines must first be converted into a graph using the LGraph component. It merges vertices within the tolerance T, removes duplicate edges and outputs a graph object G, which is passed directly to the solver.
# 
# The Edges, Vertices and the adjacency trees (PP, PL, LP) can be exposed as additional outputs by zooming in on the component (ZUI).
cables = Line([Line((-5, -5, 0), (-2.5, -5, 0)), Line((0, -5, 0), (2.5, -5, 0)), Line((-5, 0, 0), (-2.5, 0, 0)), Line((0, 0, 0), (2.5, 0, 0)), Line((-5, 5, 4), (-2.5, 5, 0)), Line((-5, -5, 0), (-5, -2.5, 0))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])
lgraph = LineGraph(Lines=cables, Tolerance=0.001)  # -> Graph, Vertices, Edges
cp = ClosestPoint(Point=anchorpts, Cloud=lgraph.Vertices)  # -> ClosestPoint, CPIndex, Distance
# (1)
lng = ListLength(List=lgraph.Edges)
q = Panel("1")
# 1) Force densities are assigned per edge. First, all edges are given a value of 1; the edge-cables are then overwritten with a value of 5.
# Note: The indices in "Indices_Edge_Cables" refer to the edge order of LGraph. If the input geometry is changed, they must be updated accordingly.
# 
# 2) For the form-finding of prestressed tension structures, the load vector is {0,0,0}. As this is the default, the "P" input can be left empty.
indices_edge_cables = Panel("""0
11
1
14
9
21
10
22
16
35
13
4
18
6
17
5""")
repeat = RepeatData(Data=q, Length=lng)
q_2 = Panel("5")
replace = ReplaceItems(List=repeat, Item=q_2, Indices=indices_edge_cables, Wrap=False)
# (2)
fdsolver = ForceDensitySolver(Fix=cp.CPIndex, Graph=lgraph.Graph, ForceDensity=replace)  # -> Vertices, Forces, Lengths, Lines
axial_forces_n_0_tension_n_0_compression = Panel(fdsolver.Forces)

# ---- group: Visualisation
# Zoom here to get the outputs for Iteration, Tolerance, displacement and residuals.
# The solver returns the equilibrium node positions (V), the axial force (N = q · L) and length (L) of each edge, the resulting edge geometry (E), as well as the residual force (Res) and the final displacement (dV) of each node for checking convergence.
# 
# The max. iterations and tolerance can be set by additional outputs by zooming in on the component (ZUI). On the right side of the component, the nodal displacement and the residuals will appear.
eval = Evaluate(E="If(x > 0, \"red\", \"blue\")", x=fdsolver.Forces)
preview = CustomPreview(Geometry=fdsolver.Lines, Material=eval)
