# Grasshopper definition 02_Opuntia_Basic_Cablenet_Struts.gh (Grasshopper 1.0.8)
# plug-ins: Opuntia

# To work with the FDM, the input lines must first be converted into a graph using the LGraph component. It merges vertices, removes duplicate edges and outputs the adjacency trees (PP,PL,LP) required by the solver.
cables = Line([Line((-5, -5, 0), (-2.5, -5, 0)), Line((0, -5, 0), (2.5, -5, 0)), Line((-5, 0, 0), (-2.5, 0, 0)), Line((0, 0, 0), (2.5, 0, 0)), Line((-5, 5, 4), (-2.5, 5, 0)), Line((-5, -5, 0), (-5, -2.5, 0))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])
# This example shows the form-finding of a classic four-point cable net:
# two anchor points are raised and two are lowered, resulting in an anticlastic, saddle-shaped surface.
# Each high point is carried by a strut, which is held in place by a guy cable.
# The coordinates, force densities and load vectors are taken from the STIFF example dataset of TU Munich:
# https://www.cee.ed.tum.de/fileadmin/w00cbe/st/Software/Education/Stiff/Beispiele/Kraftdichte_4P-Zelt_2_3D.xlsx
anchorpts = Point([Point(7, -7, 0), Point(5, -5, 1), Point(-5, -5, 0), Point(-7, 7, 0), Point(-5, 5, 1), Point(5, 5, 0)])
lgraph = LineGraph(Lines=cables, Tolerance=0.001)  # -> Vertices, Edges, PP, PL, LP
cp = ClosestPoint(Point=anchorpts, Cloud=lgraph.Vertices)  # -> ClosestPoint, CPIndex, Distance
indices_struts = Panel("""42
43""")
# 1) Force densities are assigned per edge. First, all edges are given a value of 1; the edge-cables are then overwritten with a value of 5, the struts with -5 and the guy-ropes with 10.
# You can create this list as you want, for example with a panel or from an excel file.
# 
# Note: The indices in "Indices_Edge_Cables" refer to the edge order of LGraph. If the input geometry is changed, they must be updated accordingly.
# 
# 2) For the form-finding of prestressed tension structures, the load vector is {0,0,0}. As this is the default, the "P" input can be left empty.
q = Panel("""5
5""")
constraint = ConstraintOptions(FixedEdgeIndices=indices_struts, TargetLengths=q)

# ---- group: Creating q-List
cluster = Cluster(L=lgraph.Edges, i=indices_struts)

# ----
fdsolver = ForceDensitySolver(
    AnchorIndices=cp.CPIndex,
    Vertices=lgraph.Vertices,
    PP=lgraph.PP,
    PL=lgraph.PL,
    LP=lgraph.LP,
    ForceDensity=cluster,
    Options=constraint,
    MaxIterations=1000,
    Tolerance=0.001)  # -> Vertices, Forces, Lengths, Lines, Residuals, NodeDelta
# The solver returns the equilibrium node positions (V), the axial force (N = q · L) and length (L) of each edge, the resulting edge geometry (E), as well as the residual force (Res) and the final displacement (dV) of each node for checking convergence.
formfound_cables = Line(fdsolver.Lines)
axial_forces_n_0_tension_n_0_compression = Panel(fdsolver.Forces)

# ---- group: Visualisation
smaller = SmallerThan(FirstNumber=fdsolver.Forces, SecondNumber=0)  # -> SmallerThan, OrEqualTo
panel = Panel("""red
blue""")
item = ListItem(List=panel, Index=smaller.SmallerThan, Wrap=True)
preview = CustomPreview(Geometry=formfound_cables, Material=item)

# ==== cluster Cluster
L = ClusterInput()
lng = ListLength(List=L)
q = Panel("1")
repeat = RepeatData(Data=q, Length=lng)
indices_edge_cables = Panel("""5
17
6
18
4
13
35
16
22
10
21
9
14
1
11
0""")
q_2 = Panel("5")
indices_guy_ropes = Panel("""40
41""")
replace = ReplaceItems(List=repeat, Item=q_2, Indices=indices_edge_cables, Wrap=False)
q_3 = Panel("""10
10""")
replace_2 = ReplaceItems(List=replace, Item=q_3, Indices=indices_guy_ropes, Wrap=False)
q_4 = Panel("""-5
-5""")
i = ClusterInput()
replace_3 = ReplaceItems(List=replace_2, Item=q_4, Indices=i, Wrap=False)
L_2 = ClusterOutput(replace_3)
