# Grasshopper definition 04_Opuntia_Gridshell_Contstraints.gh (Grasshopper 1.0.8)
# plug-ins: Opuntia

# This example shows the form-finding of a classic gridshell hold by the four corner vertices.
# The inner members are constraint by the length of 2.5.
# The coordinates, force densities and load vectors are taken from the STIFF example dataset of TU Munich:
# https://www.cee.ed.tum.de/fileadmin/w00cbe/st/Software/Education/Stiff/Beispiele/Kraftdichte_Gitterschale_3D.xlsx
anchorpts = Point([Point(5, 5, 0), Point(5, -5, 0), Point(-5, -5, 0), Point(-5, 5, 0)])
# To work with the FDM, the input lines must first be converted into a graph using the LGraph component. It merges vertices within the tolerance T, removes duplicate edges and outputs a graph object G, which is passed directly to the solver.
# 
# The Edges, Vertices and the adjacency trees (PP, PL, LP) can be exposed as additional outputs by zooming in on the component (ZUI).
members = Line([Line((-5, -5, 0), (-2.5, -5, 0)), Line((0, -5, 0), (2.5, -5, 0)), Line((-5, 0, 0), (-2.5, 0, 0)), Line((0, 0, 0), (2.5, 0, 0)), Line((-5, 5, 0), (-2.5, 5, 0)), Line((-5, -5, 0), (-5, -2.5, 0))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])
lgraph = LineGraph(Lines=members, Tolerance=0.001)  # -> Graph, Vertices, Edges
cp = ClosestPoint(Point=anchorpts, Cloud=lgraph.Vertices)  # -> ClosestPoint, CPIndex, Distance
# (3)
inner_members = Panel("""28
29
38
39
33
32
37
36
12
3
8
19""")
# (1)
cluster = Cluster(L=lgraph.Vertices)
# (2)
cluster_2 = Cluster_2(L=lgraph.Edges)
member_length = Panel("2.5")
# 1)Force-Vectors are assigned:
# First, all vertices are given the vector {0,0,-1}; the edge-vertices are then overwritten with the vector {0,0,-2}.
# 
# 
# 2)Force densities are assigned per edge. First, all edges are given a value of -1; the edge-cables are then overwritten with a value of -5.
# Compression strucutres the members need to have a negative forcedensity assigned.
# 
# 3) The contstraints are applied by assigning each member the desired length.
# 
# Note: The indices refer to the order of LGraph. If the input geometry is changed, they must be updated accordingly.
lng = ListLength(List=inner_members)
repeat = RepeatData(Data=member_length, Length=lng)
# The solver returns the equilibrium node positions (V), the axial force (N = q · L) and length (L) of each edge, the resulting edge geometry (E), as well as the residual force (Res) and the final displacement (dV) of each node for checking convergence.
constraint = ConstraintOptions(FixedEdgeIndices=inner_members, TargetLengths=repeat)
fdsolver = ForceDensitySolver(Fix=cp.CPIndex, Graph=lgraph.Graph, Loads=cluster, ForceDensity=cluster_2, Options=constraint)  # -> Vertices, Forces, Lengths, Lines
axial_forces_n_0_tension_n_0_compression = Panel(fdsolver.Forces)
eval = Evaluate(E="If(x > 0, \"red\", \"blue\")", x=fdsolver.Forces)
preview = CustomPreview(Geometry=fdsolver.Lines, Material=eval)

# ==== cluster Cluster
L = ClusterInput()
force_p = Panel("{0,0,-1}")
lng = ListLength(List=L)
indices_naked_vertices = Panel("""4
5
6
7
12
13
21
22
23
24""")
force_p_2 = Panel("{0,0,-2}")
repeat = RepeatData(Data=force_p, Length=lng)
replace = ReplaceItems(List=repeat, Item=force_p_2, Indices=indices_naked_vertices, Wrap=False)
L_2 = ClusterOutput(replace)

# ==== cluster Cluster_2
L = ClusterInput()
q = Panel("-1")
lng = ListLength(List=L)
indices_edge_members = Panel("""0
1
4
5
6
9
10
11
13
14
16
17
18
21
22
35""")
repeat = RepeatData(Data=q, Length=lng)
q_2 = Panel("-5")
replace = ReplaceItems(List=repeat, Item=q_2, Indices=indices_edge_members, Wrap=False)
L_2 = ClusterOutput(replace)
