# Grasshopper definition 05_Opuntia_Basic_Gridshell_De-Kink.gh (Grasshopper 1.0.8)
# plug-ins: Opuntia

members = Line([Line((-5, -5, 0), (-2.5, -5, 0)), Line((0, -5, 0), (2.5, -5, 0)), Line((-5, 0, 0), (-2.5, 0, 0)), Line((0, 0, 0), (2.5, 0, 0)), Line((-5, 5, 0), (-2.5, 5, 0)), Line((-5, -5, 0), (-5, -2.5, 0))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])
# This example shows the form-finding of a classic gridshell hold by the four corner vertices.
# This examples shows the use of the de-kink component.
# The coordinates, force densities and load vectors are taken from the STIFF example dataset of TU Munich:
# https://www.cee.ed.tum.de/fileadmin/w00cbe/st/Software/Education/Stiff/Beispiele/Kraftdichte_Gitterschale_3D.xlsx
anchorpts = Point([Point(5, 5, 0), Point(5, -5, 0), Point(-5, -5, 0), Point(-5, 5, 0)])
lgraph = LineGraph(Lines=members, Tolerance=0.001)  # -> Vertices, Edges, PP, PL, LP
cp = ClosestPoint(Point=anchorpts, Cloud=lgraph.Vertices)  # -> ClosestPoint, CPIndex, Distance
# To work with the FDM, the input lines must first be converted into a graph using the LGraph component. It merges vertices, removes duplicate edges and outputs the adjacency trees (PP,PL,LP) required by the solver.
number_slider = Slider(30, range=0..100)
# 1)Force-Vectors are assigned:
# First, all vertices are given the vector {0,0,-1}; the edge-vertices are then overwritten with the vector {0,0,-2}.
# 
# 
# 2)Force densities are assigned per edge. First, all edges are given a value of -1; the edge-cables are then overwritten with a value of -5.
# Compression strucutres the members need to have a negative forcedensity assigned.
# 
# 3) The contstraints are applied by feeding the boundary-vertices and assigning an angle-tolerance. Adjust the smooth-passes until you get the desired output.
# 
# Note: The indices refer to the order of LGraph. If the input geometry is changed, they must be updated accordingly.
number_slider_2 = Slider(4, range=0..10)
# (1)
cluster = Cluster(L=lgraph.Vertices)
# (2)
cluster_2 = Cluster_2(L=lgraph.Edges)
# (3)
indices_naked_vertices = Panel("""0
1
2
3
4
8
9
10
11
14
15
16
17
18
19
20""")
# The solver returns the equilibrium node positions (V), the axial force (N = q · L) and length (L) of each edge, the resulting edge geometry (E), as well as the residual force (Res) and the final displacement (dV) of each node for checking convergence.
entknick = EntknickOptions(BoundaryIndices=indices_naked_vertices, AngleTolerance=number_slider, SmoothPasses=number_slider_2)
fdsolver = ForceDensitySolver(
    AnchorIndices=cp.CPIndex,
    Vertices=lgraph.Vertices,
    PP=lgraph.PP,
    PL=lgraph.PL,
    LP=lgraph.LP,
    Loads=cluster,
    ForceDensity=cluster_2,
    Options=flatten(entknick),
    MaxIterations=1000,
    Tolerance=0.001)  # -> Vertices, Forces, Lengths, Lines, Residuals, NodeDelta
axial_forces_n_0_tension_n_0_compression = Panel(fdsolver.Forces)
formfound_cables = Line(fdsolver.Lines)

# ---- group: Visualisation
preview = CustomPreview(
    Geometry=formfound_cables,
    Material={diffuse=RGB(255, 0, 255), emission=RGB(76, 0, 76), shine=0.5, specular=RGB(255, 255, 255), transparency=0})

# ==== cluster Cluster
L = ClusterInput()
force_p = Panel("{0,0,-1}")
lng = ListLength(List=L)
indices_naked_vertices = Panel("""5
6
7
12
13
21
22
23
24""")
force_p_2 = Panel("{0,0,-2}")
repeat = RepeatData(Data=force_p, Length=lng)
replace = ReplaceItems(List=repeat, Item=force_p_2, Indices=indices_naked_vertices, Wrap=False)
L_2 = ClusterOutput(replace)

# ==== cluster Cluster_2
L = ClusterInput()
q = Panel("-1")
lng = ListLength(List=L)
indices_edge_members = Panel("""0
1
4
5
6
9
10
11
13
14
16
17
18
21
22
35""")
repeat = RepeatData(Data=q, Length=lng)
q_2 = Panel("-5")
replace = ReplaceItems(List=repeat, Item=q_2, Indices=indices_edge_members, Wrap=False)
L_2 = ClusterOutput(replace)
