# Grasshopper definition 06_Opuntia_Basic_Olympia_4_Panels.gh (Grasshopper 1.0.8)
# plug-ins: Opuntia

# To work with the FDM, the input lines must first be converted into a graph using the LGraph component. It merges vertices, removes duplicate edges and outputs the adjacency trees (PP,PL,LP) required by the solver.
cables_struts = Geometry([Line((-6, 4, 0), (-3.501114, 2.940282, 0)), Line((-6, -6, 0), (-6, -3.5, 0)), Line((-6, -1, 0), (-6, 1.5, 0)), Line((4, -6, 0), (4, -4.25, 0)), Line((-6, -3.5, 0), (-6, -1, 0)), Line((-6, 1.5, 0), (-6, 4, 0))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])
# This example shows the form-finding of a roof section of the Munich Olympic Stadium consisting of four panels.
# The coordinates, force densities and load vectors are taken from the STIFF example dataset of TU Munich:
# https://www.cee.ed.tum.de/fileadmin/w00cbe/st/Software/Education/Stiff/Beispiele/Kraftdichte_Olympia_5_4-Felder_3D.xlsx
anchorpts = Geometry([Point(-7.994977, -0.698786, -2), Point(-12, 0.043961, -1), Point(-6, -16, 0), Point(4, -13, 0), Point(-7.994977, -11.301214, -2), Point(-12, -12.043961, -1), Point(-10, -6, -2), Point(11.501822, 13.093197, 0), Point(0.43616, 18.024369, -2), Point(-2.562851, 20.780783, -1), Point(-6, 4, 0), Point(-5.19482, 9.040854, -2), Point(-8.982781, 10.538598, -1), Point(-4.078201, 14.597485, -2), Point(4.622057, 20.946147, 0)])
lgraph = LineGraph(Lines=cables_struts, Tolerance=0.001)  # -> Vertices, Edges, PP, PL, LP
cp = ClosestPoint(Point=anchorpts, Cloud=lgraph.Vertices)  # -> ClosestPoint, CPIndex, Distance
# (1)
q_pro_kante = Data(["5", "8", "8", "40", "8", "8", "5", "5", "5", "40"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])
# (3)
indices_fixed_lengths = Panel("""80
163
37
121""")
# 1) Force densities are assigned per edge.
# The values are obtained from STIFF3D(see above).
# 
# Note: The indices in "Indices_Edge_Cables" refer to the edge order of LGraph. If the input geometry is changed, they must be updated accordingly.
# 
# 2) For the form-finding of prestressed tension structures, the load vector is {0,0,0}. As this is the default, the "P" input can be left empty.
# 
# 3) The contstraints are applied by assigning each member the desired length.
# 
# Note: The indices refer to the order of LGraph. If the input geometry is changed, they must be updated accordingly.
target_lengths = Panel("""8
8
8
8""")
constraint = ConstraintOptions(FixedEdgeIndices=indices_fixed_lengths, TargetLengths=target_lengths)
# (2)
fdsolver = ForceDensitySolver(
    AnchorIndices=cp.CPIndex,
    Vertices=lgraph.Vertices,
    PP=lgraph.PP,
    PL=lgraph.PL,
    LP=lgraph.LP,
    ForceDensity=q_pro_kante,
    Options=constraint,
    MaxIterations=1000,
    Tolerance=0.001)  # -> Vertices, Forces, Lengths, Lines, Residuals, NodeDelta
# The solver returns the equilibrium node positions (V), the axial force (N = q · L) and length (L) of each edge, the resulting edge geometry (E), as well as the residual force (Res) and the final displacement (dV) of each node for checking convergence.
formfound_cables = Line(fdsolver.Lines)
axial_forces_n_0_tension_n_0_compression = Panel(fdsolver.Forces)

# ---- group: Visualisation
smaller = SmallerThan(FirstNumber=fdsolver.Forces, SecondNumber=0)  # -> SmallerThan, OrEqualTo
panel = Panel("""red
blue""")
item = ListItem(List=panel, Index=smaller.SmallerThan, Wrap=True)
preview = CustomPreview(Geometry=formfound_cables, Material=item)
