# Grasshopper definition 07_Opuntia_Anchors.gh (Grasshopper 1.0.8)
# plug-ins: Opuntia

free_vertices_indices = List(["1", "2", "3", "4", "5", "6", "7", "9", "10", "11", "12", "13", "15", "16", "17", "18", "19", "21", "22", "23", "24"])
list = ValueList({"Anchor 1": 0, "Anchor 2": 8, "Anchor 3": 14, "Anchor 4": 20}, selected="Anchor 1")
# Supports: Supports are defined via the Fix input. Each entry is either a plain vertex index, which fixes the vertex in x, y and z (e.g. “3”), or an index followed by the axes to be fixed (e.g. “3xy”, “7z”). Axes not listed remain free.
# 
# Try fixing individual axes using the value lists. Each axis can be locked (on) or released (off) separately. For example, “3xy” fixes vertex 3 in x and y, while it can still move in z.
# 
# Note: If all axes of the free vertices are fixed, no vertex can move and no equilibrium shape can be found.
anchor_indices = List([0, 8, 14, 20])
list_2 = ValueList({"y_on": "y", "y_off": }, selected="y_on")
list_3 = ValueList({"z_on": "z", "z_off": }, selected="z_on")
list_4 = ValueList({"x_on": "x", "x_off": }, selected="x_on")
list_5 = ValueList({"y_on": "y", "y_off": }, selected="y_on")
list_6 = ValueList({"x_on": "x", "x_off": }, selected="x_on")
list_7 = ValueList({"z_on": "z", "z_off": }, selected="z_off")
cables = Line([Line((-5, -5, 0), (-2.5, -5, 0)), Line((0, -5, 0), (2.5, -5, 0)), Line((-5, 0, 0), (-2.5, 0, 0)), Line((0, 0, 0), (2.5, 0, 0)), Line((-5, 5, 4), (-2.5, 5, 0)), Line((-5, -5, 0), (-5, -2.5, 0))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])
lgraph = LineGraph(Lines=cables, Tolerance=0.001)
concat = Concatenate(FragmentA=list, FragmentB=list_4, FragmentC=list_2, FragmentD=list_3)
concat_2 = Concatenate(FragmentA=free_vertices_indices, FragmentB=list_6, FragmentC=list_5, FragmentD=list_7)
replace = ReplaceItems(List=anchor_indices, Item=concat, Indices=list, Wrap=False)
q_values = Data(["5", "5", "1", "1", "5", "5", "5", "1", "1", "5", "5", "5", "1", "5", "5", "1", "5", "5", "5", "1", "1", "5", "5", "1", "1", "1", "1", "1", "1", "1", "1", "1", "1", "1", "1", "5", "1", "1", "1", "1"])
fdsolver = ForceDensitySolver(Fix=flatten([replace, concat_2]), Graph=lgraph, ForceDensity=q_values)  # -> Vertices, Forces, Lengths, Lines

# ---- group: Visualisation
eval = Evaluate(E="If(x > 0, \"red\", \"blue\")", x=fdsolver.Forces)
preview = CustomPreview(Geometry=fdsolver.Lines, Material=eval)
